# Dynamo graph Calc_SumDimsValue.dyn (Dynamo 2.16.2.5624)
# packages: spring nodes 210.1.1

select_model_element = DSModelElementSelection()  # nothing selected; graph input
value = Dimension.Value(dimension=select_model_element)
sum = Math.Sum(values=value)
# note: Custom Node: spring nodesv.210.1.1
ꟿ_feet_tofraction = Custom[ꟿ Feet.ToFraction](number=sum)  # package spring nodes; Converts a decimal foot value to a fractional foot/inch string.
watch = Watch(ꟿ_feet_tofraction)  # graph output
