# Dynamo graph Calc_SurfaceArea.dyn (Dynamo 2.10.1.3976)

select_model_element = DSModelElementSelection()  # 1 picked in the model; graph input
code_block = CodeBlock { "Surface Area"; }
faces = Element.Faces(element=select_model_element)
area = Surface.Area(surface=faces)
flatten = List.Flatten(list=area)
sum = Math.Sum(values=flatten)
round = Math.Round(number=sum)
watch = Watch(round)  # graph output
setParameterByName = Element.SetParameterByName(element=select_model_element, parameterName=code_block, value=watch)  # graph output
