# Dynamo graph Copy_LinkedElements.dyn (Dynamo 2.16.2.5624)
# packages: bimorphNodes 5.1.3, Rhythm 2023.9.1

select_model_element = DSModelElementSelection()  # 1 picked in the model; graph input
categories = Categories("OST_SpecialityEquipment")  # graph input
ofCategory = Revit.LinkElement.OfCategory(linkInstance=select_model_element, category=categories)
element_name_contains = StringInput("HSS")  # graph input
string = StringInput("Contains")
ʳʰʸᵗʰᵐ_elementfilter_byname = Rhythm.Revit.ElementFilter.ElementFilter.ByName(elements=ofCategory, value=element_name_contains, filterMethod=string)
copyToActiveDocument = Revit.LinkElement.CopyToActiveDocument(linkElements=ʳʰʸᵗʰᵐ_elementfilter_byname)  # graph output
