# Dynamo graph Create_dimStructuralFraming.dyn (Dynamo 2.16.2.5624)
# packages: Genius Loci 2024.2.26

select_dimension_line_loc = DSModelElementSelection()  # 1 picked in the model; graph input
curves = Element.Curves(element=select_dimension_line_loc)
select_model_elements = DSModelElementsSelection()  # 9 picked in the model; graph input
# note: Custom Node: GeniusLociv.2024.2.26
familyinstance_referencetype = Custom[FamilyInstance ReferenceType]()  # package Genius Loci; Works only in Revit 2018.1 and later. Identifies references of family instances corresponding to reference planes and reference lines in the family.
ref_plane_1 = CustomSelection("Left", items={Left: "0", CenterLeftRight: "1", Right: "2", Front: "3", CenterFrontBack: "4", Back: "5", Bottom: "6", CenterElevation: "7", Top: "8", Strong Ref: "9", Weak Ref: "10", Not A Ref: "11"})  # graph input
ref_plane_2 = CustomSelection("Right", items={Left: "0", CenterLeftRight: "1", Right: "2", Front: "3", CenterFrontBack: "4", Back: "5", Bottom: "6", CenterElevation: "7", Top: "8", Strong Ref: "9", Weak Ref: "10", Not A Ref: "11"})  # graph input
list_create = List.Create(item0=ref_plane_1, item1=ref_plane_2)
getItemAtIndex = List.GetItemAtIndex(list=familyinstance_referencetype, index=list_create)
familyinstance_reference = Custom[FamilyInstance Reference ByRefLine](familyInstance=select_model_elements, ReferenceType=getItemAtIndex)  # package Genius Loci; Works only in Revit 2018.1 and later. Gets the reference corresponding to the given Reference Line in the family instance.
flatten = List.Flatten(list=familyinstance_reference)
dimension_byreferences = Custom[Dimension ByReferences](line=curves, references=flatten)  # package Genius Loci; Creates a new linear dimension from at least two geometric references of an object.
