# Dynamo graph Create_placeFamilyTypeByCoord.dyn (Dynamo 2.16.2.5624)
# packages: Clockwork for Dynamo 2.x 2.6.0

categories = Categories("OST_SpecialityEquipment")
# note: Custom Node: Clockwork
all_family_types_of_category = Custom[All Family Types Of Category](category=categories)  # package Clockwork for Dynamo 2.x; Gets all family types/symbols of a given category in the model.
x_starting_point = DoubleInput(1)  # graph input
x_end_point = DoubleInput(5000)  # graph input
distance = DoubleInput(10)  # graph input
range = Range(start=x_starting_point, end=x_end_point, step=distance)
y_starting_point = DoubleInput(1)  # graph input
y_end_point = DoubleInput(5000)  # graph input
range_2 = Range(start=y_starting_point, end=y_end_point, step=distance)
byCoordinates = Point.ByCoordinates(x=range, y=range_2)
byPoint = FamilyInstance.ByPoint(familyType=all_family_types_of_category, point=byCoordinates)
