# Dynamo graph Edit_BatchUpgrade.dyn (Dynamo 2.16.2.5624)
# packages: Crumple 2022.5.27, Rhythm 2023.9.1

# note: Copyright (c) 2024 Anas Zokronain
# Permission is hereby granted, free of charge, to any person obtaining a copy
# of this software and associated documentation files (the "Software"), to deal
# in the Software without restriction, including without limitation the rights
# to use, copy, modify, merge, publish, distribute, sublicense, and/or sell
# copies of the Software, and to permit persons to whom the Software is
# furnished to do so, subject to the following conditions:
# The above copyright notice and this permission notice shall be included in all
# copies or substantial portions of the Software.
# THE SOFTWARE IS PROVIDED "AS IS", WITHOUT WARRANTY OF ANY KIND, EXPRESS OR
# IMPLIED, INCLUDING BUT NOT LIMITED TO THE WARRANTIES OF MERCHANTABILITY,
# FITNESS FOR A PARTICULAR PURPOSE AND NONINFRINGEMENT. IN NO EVENT SHALL THE
# AUTHORS OR COPYRIGHT HOLDERS BE LIABLE FOR ANY CLAIM, DAMAGES OR OTHER
# LIABILITY, WHETHER IN AN ACTION OF CONTRACT, TORT OR OTHERWISE, ARISING FROM,
# OUT OF OR IN CONNECTION WITH THE SOFTWARE OR THE USE OR OTHER DEALINGS IN THE
# SOFTWARE.

directory_path = Directory("C:\Users\PC2\Desktop\Anas\Revit\Families\R23")  # graph input
boolean = BoolSelector(true)
windows_directorycontents = Custom[© Windows.DirectoryContents](directoryPath=directory_path, deepSearch=boolean)  # package Crumple; Be aware there is an OOTB node that can do this, but I wanted to add this to the package so others can see how to use a Python method as a starter block in other scripts.
rhythm_ʳʰʸᵗʰᵐ_applications = Rhythm.Revit.Application.Applications.OpenDocumentFile(filePath=windows_directorycontents)
boolean_2 = BoolSelector(true)
rhythm_ʳʰʸᵗʰᵐ_applications_2 = Rhythm.Revit.Application.Applications.CloseDocument(document=rhythm_ʳʰʸᵗʰᵐ_applications, save=boolean_2)
watch = Watch(rhythm_ʳʰʸᵗʰᵐ_applications_2)  # graph output
