# Dynamo graph Edit_CreateSheetsFromExcel.dyn (Dynamo 2.10.1.3976)
# packages: ExcelReader 134.1.1, Clockwork for Dynamo 2.x 2.6.0, Crumple 2022.5.27, Rhythm 2022.11.4

boolean = BoolSelector(true)
boolean_2 = BoolSelector(false)
file_path = Filename("..\23-217-T (2318) E-Sheet Index.xlsx")  # graph input
file_from_path = FileObject(path=file_path)
string = StringInput("issued")
read = EPPlus.ExcelReader.ExcelFile.Read(file=file_from_path, sheetName=string)
code_block = CodeBlock { 2; }
getItemAtIndex = List.GetItemAtIndex(list=read, index=code_block)
string_2 = StringInput("E\d\d")
code_block_2 = CodeBlock { 1; }
getItemAtIndex_2 = List.GetItemAtIndex(list=read, index=code_block_2)
code_block_3 = CodeBlock { "0"; }
replaceNull = Custom[List.ReplaceNull](seq=getItemAtIndex_2, replacement=code_block_3)  # package Clockwork for Dynamo 2.x; Replaces all null values within a given list with a substitute
string_regex = Custom[© String.Regex](regex=string_2, strings=replaceNull)  # package Crumple; Based on a single regex statement, check all strings against it.
filterByBoolMask = List.FilterByBoolMask(list=getItemAtIndex, mask=string_regex)
filterByBoolMask_2 = List.FilterByBoolMask(list=getItemAtIndex_2, mask=string_regex)
family_types = FamilyTypes("D 22 x 34 Horizontal:D 22 x 34 Horizontal")  # graph input
views = Views("Drafting")  # graph input
sheet_origin_point = CodeBlock { 0; }
byCoordinates = Point.ByCoordinates(x=sheet_origin_point, y=sheet_origin_point, z=sheet_origin_point)
byNameNumberTitleBlockViewAndLocation = Sheet.ByNameNumberTitleBlockViewAndLocation(sheetName=filterByBoolMask.in, sheetNumber=filterByBoolMask_2.in, titleBlockFamilyType=family_types, view=views, location=byCoordinates)
watch = Watch(byNameNumberTitleBlockViewAndLocation)  # graph output
