# Dynamo graph Edit_CreateSheetsFromExcel_Python.dyn (Dynamo 2.10.1.3976)
# packages: Crumple 2022.5.27

family_types = FamilyTypes("D 22 x 34 Horizontal:D 22 x 34 Horizontal")
code_block = CodeBlock { ["Key Plan", "Fdtn Plan", "Sector Plan"]; ["E01","E02","E03"]; }
boolean = BoolSelector(false)
python_script = Python(IN[0]=family_types, IN[1]=code_block.out0, IN[2]=code_block.out1, IN[3]=boolean)  # IronPython2
# ---------- python_script.python (72 lines) ----------
#checkcheckrockrock
# copyright Anas

import clr
# import clr module for Python to interact with .NET

clr.AddReference("RevitNodes")
import Revit
clr.ImportExtensions(Revit.Elements)
# add reference to RevitNodes library then import the Revit module then import extensions from Revit.Elements. Allow us to use Revit's elements and their method and properties

clr.AddReference("RevitServices")
import RevitServices
from RevitServices.Persistence import DocumentManager
from RevitServices.Transactions import TransactionManager
# add reference to RevitServices library then import RevitServices module then import DocumentManager and TransactionManager. DocumentManager manage current Revit document and TransactionManager manage changes in the Revit document.

clr.AddReference("RevitAPI")
import Autodesk
from Autodesk.Revit.DB import *
# add reference to RevitAPI library, import the Autodesk module then import everythin from Autodesk.Revit.DB. Allows us to use Revit's API

doc = DocumentManager.Instance.CurrentDBDocument
# gets the current open Revit document

def inputToList(input):
	result = input if isinstance (input, list) else [input]
	return result
#converts all input to list, no changes to the input already list

sheets = 
FilteredElementCollector(doc).OfCategory(BuiltInCategory.OST_Sheets).WhereElementIsNotElementType().ToElements()
# collect all sheets in  the current Revit document - exclude element types - convert the collection to a list of elements

extSheetNumbers = [s.SheetNumber for s in sheets]
# list of all sheet numbers of collected sheets above

titleblock_dyn = IN[0] #specify titleblock family in Dynamo nodes
newSheetName = inputToList (IN[1]) # sheet name input as list
newSheetNumbers = inputToList (IN[2]) # sheet number inpput as list
newSheetPlaceholder = IN[3] # boolean, whether the new sheets should be placeholders

sheetNumberExist = [n in extSheetNumbers for n in newSheetNumbers]
# check if each number newSheetNumbers already exists in extSheetNumbers, also create list of booleans where True if exists and False if doesn't

sheets, success = [],[]
# initialize two empty list 

titleblock_rvt = UnwrapElement(titleblock_dyn).Id
# unwrap titleblock from dynamo and obtain its Id

TransactionManager.Instance.EnsureInTransaction(doc)
# start transaction

for nShtName, nShtNum, nShtPlchldr in zip(newSheetName, newSheetNumbers, sheetNumberExist)
	if nShtPlchldr == False:
		if newSheetPlaceholder = True:
			placeholder = ViewSheet.CreatePlaceholder(doc)
		else:
			placeholder = ViewSheet.Create(doc, titleblock_rvt)
		placeholder.SheetNumber = nShtNum
		placeholder.Name = nShtName
		sheets.append(placeholder.ToDSType(False))
		success.append(True)
	else:
		sheets.append(None)
		success.append(False)
		
TransactionManager.Instance.TransactionTaskDone()
# closing the transaction

OUT = [sheets, success]
# ----------------------------------------
family_types_2 = FamilyTypes("D 22 x 34 Horizontal:D 22 x 34 Horizontal")
code_block_2 = CodeBlock { ["Key Plan", "Fdtn Plan", "Sector Plan"]; ["E01","E02","E03"]; }
sheets_create = Custom[© Sheets.Create](ttb_type=family_types_2, names=code_block_2.out0, numbers=code_block_2.out1)  # package Crumple; Creates Revit sheets based on a list of names, numbers and a single Titleblock type.
family_types_3 = FamilyTypes("D 22 x 34 Horizontal:D 22 x 34 Horizontal")
code_block_3 = CodeBlock { ["Key Plan", "Fdtn Plan", "Sector Plan"]; ["E01","E02","E03"]; }
boolean_2 = BoolSelector(false)
python_script_2 = Python(IN[0]=family_types_3, IN[1]=code_block_3.out0, IN[2]=code_block_3.out1, IN[3]=boolean_2)  # IronPython2
# ---------- python_script_2.python (99 lines) ----------
#Copyright Anas 2024
#Use at you own risk

import clr
# import clr module for Python to interact with .NET

clr.AddReference("RevitNodes")
import Revit
clr.ImportExtensions(Revit.Elements)
# add reference to RevitNodes library then import the Revit module then import extensions from Revit.Elements. Allow us to use Revit's elements and their method and properties

clr.AddReference("RevitServices")
import RevitServices
from RevitServices.Persistence import DocumentManager
from RevitServices.Transactions import TransactionManager
# add reference to RevitServices library then import RevitServices module then import DocumentManager and TransactionManager. DocumentManager manage current Revit document and TransactionManager manage changes in the Revit document.

clr.AddReference("RevitAPI")
import Autodesk
from Autodesk.Revit.DB import *
# add reference to RevitAPI library, import the Autodesk module then import everythin from Autodesk.Revit.DB. Allows us to use Revit's API

doc = DocumentManager.Instance.CurrentDBDocument
# gets the current open Revit document

def inputToList(input):
    result = input if isinstance (input, list) else [input]
    return result
#converts all input to list, no changes to the input already list

sheets = FilteredElementCollector(doc).OfCategory(BuiltInCategory.OST_Sheets).WhereElementIsNotElementType().ToElements()
# collect all sheets in  the current Revit document - exclude element types - convert the collection to a list of elements

# Initialize an empty list
extSheetNumbers = []

# Loop through each sheet in the list of sheets
for s in sheets:
    # Get the sheet number of the current sheet
    sheet_number = s.SheetNumber
    
    # Append the sheet number to the list
    extSheetNumbers.append(sheet_number)

titleblock_dyn = IN[0] #specify titleblock family in Dynamo nodes
newSheetName = inputToList (IN[1]) # sheet name input as list
newSheetNumbers = inputToList (IN[2]) # sheet number inpput as list
newSheetPlaceholder = IN[3] # boolean, whether the new sheets should be placeholders

sheetNumberExist = [n in extSheetNumbers for n in newSheetNumbers]
# check if each number newSheetNumbers already exists in extSheetNumbers, also create list of booleans where True if exists and False if doesn't

sheets, success = [],[]
# initialize two empty list 

titleblock_rvt = UnwrapElement(titleblock_dyn).Id
# unwrap titleblock from dynamo and obtain its Id

TransactionManager.Instance.EnsureInTransaction(doc)
# start transaction

# Start the loop
for i in range(len(newSheetName)):
    # Get the current sheet name, number, and existence check
    nShtName = newSheetName[i]
    nShtNum = newSheetNumbers[i]
    nShtPlchldr = sheetNumberExist[i]

    # Check if the sheet number doesn't exist
    if nShtPlchldr == False:
        # Check if the new sheet should be a placeholder
        if newSheetPlaceholder == True:
            # Create a placeholder sheet
            placeholder = ViewSheet.CreatePlaceholder(doc)
        else:
            # Create a regular sheet with the specified title block
            placeholder = ViewSheet.Create(doc, titleblock_rvt)
        
        # Set the sheet number and name
        placeholder.SheetNumber = nShtNum
        placeholder.Name = nShtName
        
        # Convert the sheet to a Dynamo type and append it to the sheets list
        sheets.append(placeholder.ToDSType(False))
        
        # Append True to the success list
        success.append(True)
    else:
        # If the sheet number exists, append None to the sheets list
        sheets.append(None)
        
        # Append False to the success list
        success.append(False)

TransactionManager.Instance.TransactionTaskDone()
# closing the transaction

OUT = [sheets, success]
# set the output for Dynamo. It's a list containing the sheets and success lists. The sheets list contains the new sheets (or None if the sheet number already existed), and the success list contains True for each successful creation and False for each failed creation.
# ----------------------------------------
