# Dynamo graph Edit_CreateViewPlan_Python.dyn (Dynamo 2.10.1.3976)
# packages: Crumple 2022.5.27

# note: Copyright (c) 2024 Anas Zokronain
# Permission is hereby granted, free of charge, to any person obtaining a copy
# of this software and associated documentation files (the "Software"), to deal
# in the Software without restriction, including without limitation the rights
# to use, copy, modify, merge, publish, distribute, sublicense, and/or sell
# copies of the Software, and to permit persons to whom the Software is
# furnished to do so, subject to the following conditions:
# The above copyright notice and this permission notice shall be included in all
# copies or substantial portions of the Software.
# THE SOFTWARE IS PROVIDED "AS IS", WITHOUT WARRANTY OF ANY KIND, EXPRESS OR
# IMPLIED, INCLUDING BUT NOT LIMITED TO THE WARRANTIES OF MERCHANTABILITY,
# FITNESS FOR A PARTICULAR PURPOSE AND NONINFRINGEMENT. IN NO EVENT SHALL THE
# AUTHORS OR COPYRIGHT HOLDERS BE LIABLE FOR ANY CLAIM, DAMAGES OR OTHER
# LIABILITY, WHETHER IN AN ACTION OF CONTRACT, TORT OR OTHERWISE, ARISING FROM,
# OUT OF OR IN CONNECTION WITH THE SOFTWARE OR THE USE OR OTHER DEALINGS IN THE
# SOFTWARE.
# tldr : i am not responsible for your mess, fix it yourself

levels = Levels("T.O. PRECAST")
code_block = CodeBlock { "cubatrytest"; }
python_script = Python(IN[0]=levels, IN[1]=code_block)  # IronPython2; unwired: IN[2]
# ---------- python_script.python (58 lines) ----------
import clr

# Import RevitNodes and extend functionality
clr.AddReference("RevitNodes")
import Revit
clr.ImportExtensions(Revit.Elements)

# Import RevitServices for document management and transactions
clr.AddReference("RevitServices")
import RevitServices
from RevitServices.Persistence import DocumentManager
from RevitServices.Transactions import TransactionManager

# Import RevitAPI for direct interaction with Revit elements
clr.AddReference("RevitAPI")
import Autodesk
from Autodesk.Revit.DB import *

# Get the current Revit document
doc = DocumentManager.Instance.CurrentDBDocument

# Define a function to convert input to a list
def toList(input):
    result = input if isinstance(input, list) else [input]
    return result

# Define a function to unwrap input elements
def uwlist(input):
    result = input if isinstance(input, list) else [input]
    return UnwrapElement(result)

# Unwrap input levels, names, and view type
levels = uwlist(IN[0])
viewNames = toList(IN[1])
viewType = UnwrapElement(IN[2])

# Initialize empty lists for output
viewOut, result = [], []

# Start a transaction
TransactionManager.Instance.EnsureInTransaction(doc)

# Create view plans for each level and assign names
for lev, name in zip(levels, viewNames):
    view = ViewPlan.Create(doc, viewType.Id, lev.Id)
    try:
        view.Name = name
        success = True
    except:
        success = False
    viewOut.append(view.ToDSType(False))
    result.append(success)

# Commit the transaction
TransactionManager.Instance.TransactionTaskDone()

# Prepare output for Dynamo
OUT = [viewOut, result]
# ----------------------------------------
views_createplans = Custom[© Views.CreatePlans](levels=levels, names=code_block)  # package Crumple; Given an even list of levels and names and a view type, this node will create new plan views for those levels and attempt to rename them if a name is available. You can automate the application of view templates by assigning them to the view types in Revit as well. If you feed in a ceiling plan type, it will make a ceiling plan due to how the ViewPlan API works.; unwired: viewType
watch = Watch(views_createplans.planViews)
