# Dynamo graph Edit_Delete3DViewsOnSheet.dyn (Dynamo 2.16.2.5624)

categories = Categories("OST_Sheets")
all_elements_of_category = ElementsOfCategory(Category=categories)
sheetNumber = Sheet.SheetNumber(sheet=all_elements_of_category)
string = StringInput("A5.")
contains = String.Contains(string=sheetNumber, searchFor=string)
filterByBoolMask = List.FilterByBoolMask(list=all_elements_of_category, mask=contains)
views = Sheet.Views(sheet=filterByBoolMask.in)
