# Dynamo graph Edit_DeleteViewsOnSheet.dyn (Dynamo 2.16.2.5624)

categories = Categories("OST_Sheets")  # graph input
all_elements_of_category = ElementsOfCategory(Category=categories)
sheetNumber = Sheet.SheetNumber(sheet=all_elements_of_category)
sheet_name_contains = StringInput("A5.")  # graph input
contains = String.Contains(string=sheetNumber, searchFor=sheet_name_contains)
filterByBoolMask = List.FilterByBoolMask(list=all_elements_of_category, mask=contains)
viewports = Sheet.Viewports(sheet=filterByBoolMask.in)
code_block = CodeBlock(x=viewports) { x.View; }
elementType = Element.ElementType(element=code_block)
name = Element.Name(element=elementType)  # graph output
view_name = StringInput("Legend")  # graph input
contains_2 = String.Contains(string=name, searchFor=view_name)
filterByBoolMask_2 = List.FilterByBoolMask(list=viewports, mask=contains_2)
delete = Element.Delete(element=filterByBoolMask_2.in)
watch = Watch(delete)  # graph output
