# Dynamo graph Edit_columnElevationParam.dyn (Dynamo 2.10.1.3976)

# note: Copyright (c) 2024 Anas Zokronain
# Permission is hereby granted, free of charge, to any person obtaining a copy
# of this software and associated documentation files (the "Software"), to deal
# in the Software without restriction, including without limitation the rights
# to use, copy, modify, merge, publish, distribute, sublicense, and/or sell
# copies of the Software, and to permit persons to whom the Software is
# furnished to do so, subject to the following conditions:
# The above copyright notice and this permission notice shall be included in all
# copies or substantial portions of the Software.
# THE SOFTWARE IS PROVIDED "AS IS", WITHOUT WARRANTY OF ANY KIND, EXPRESS OR
# IMPLIED, INCLUDING BUT NOT LIMITED TO THE WARRANTIES OF MERCHANTABILITY,
# FITNESS FOR A PARTICULAR PURPOSE AND NONINFRINGEMENT. IN NO EVENT SHALL THE
# AUTHORS OR COPYRIGHT HOLDERS BE LIABLE FOR ANY CLAIM, DAMAGES OR OTHER
# LIABILITY, WHETHER IN AN ACTION OF CONTRACT, TORT OR OTHERWISE, ARISING FROM,
# OUT OF OR IN CONNECTION WITH THE SOFTWARE OR THE USE OR OTHER DEALINGS IN THE
# SOFTWARE.

# group: Select elements
categories = Categories("OST_StructuralColumns")  # graph input
all_elements_of_category = ElementsOfCategory(Category=categories)
select_model_elements = DSModelElementsSelection()  # 3 picked in the model; graph input

# group: Get element vertices, filter out empty lists
geometry = Element.Geometry(element=all_elements_of_category)
isEmpty = List.IsEmpty(list=geometry@L2)
filterByBoolMask = List.FilterByBoolMask(list=all_elements_of_category, mask=isEmpty)
isEmpty_2 = List.IsEmpty(list=geometry@L2)
filterByBoolMask_2 = List.FilterByBoolMask(list=geometry, mask=isEmpty_2)
vertices = Topology.Vertices(topology=filterByBoolMask_2.out)
code_block = CodeBlock { 1; }
flatten = List.Flatten(list=vertices, amt=code_block)
pointGeometry = Vertex.PointGeometry(vertex=flatten)
Z = Point.Z(point=pointGeometry)

# group: Write data to the element
code_block_2 = CodeBlock { "Top Elevation"; }
maximumItem = List.MaximumItem(list=Z)
setParameterByName = Element.SetParameterByName(element=filterByBoolMask.out, parameterName=code_block_2, value=maximumItem)
code_block_3 = CodeBlock { "Bottom Elevation"; }
minimumItem = List.MinimumItem(list=Z)
setParameterByName_2 = Element.SetParameterByName(element=filterByBoolMask.out, parameterName=code_block_3, value=minimumItem)
