# Dynamo graph Edit_createDimension.dyn (Dynamo 2.10.1.3976)
# packages: Genius Loci 2024.2.26, Crumple 2022.5.27

# note: Copyright (c) 2024 Anas Zokronain
# Permission is hereby granted, free of charge, to any person obtaining a copy
# of this software and associated documentation files (the "Software"), to deal
# in the Software without restriction, including without limitation the rights
# to use, copy, modify, merge, publish, distribute, sublicense, and/or sell
# copies of the Software, and to permit persons to whom the Software is
# furnished to do so, subject to the following conditions:
# The above copyright notice and this permission notice shall be included in all
# copies or substantial portions of the Software.
# THE SOFTWARE IS PROVIDED "AS IS", WITHOUT WARRANTY OF ANY KIND, EXPRESS OR
# IMPLIED, INCLUDING BUT NOT LIMITED TO THE WARRANTIES OF MERCHANTABILITY,
# FITNESS FOR A PARTICULAR PURPOSE AND NONINFRINGEMENT. IN NO EVENT SHALL THE
# AUTHORS OR COPYRIGHT HOLDERS BE LIABLE FOR ANY CLAIM, DAMAGES OR OTHER
# LIABILITY, WHETHER IN AN ACTION OF CONTRACT, TORT OR OTHERWISE, ARISING FROM,
# OUT OF OR IN CONNECTION WITH THE SOFTWARE OR THE USE OR OTHER DEALINGS IN THE
# SOFTWARE.

revit_currentview = Custom[© Revit.CurrentView]()  # package Crumple; Given the current document, return the active view.
select_model_elements = DSModelElementsSelection()  # 80 picked in the model; graph input
curves = Element.Curves(element=select_model_elements)
code_block = CodeBlock { 0.5; }
normalAtParameter = Curve.NormalAtParameter(curve=curves, param=code_block)
translate = Geometry.Translate(geometry=curves, direction=normalAtParameter)
wall_edges_references = Custom[Wall Edges References](wall=select_model_elements)  # package Genius Loci; Get the vertical and horizontal edges and their references from the exterior and interior faces. Also works with linked walls.
dimension_byreferences = Custom[Dimension ByReferences](view=revit_currentview, line=translate, references=wall_edges_references.Exterior_Side_Vertical_References)  # package Genius Loci; Creates a new linear dimension from at least two geometric references of an object.
