# Dynamo graph Edit_deleteElements.dyn (Dynamo 2.16.2.5624)
# packages: archi-lab.net 2023.213.1722

element_classes = ElementTypes("LinePatternElement")  # graph input
all_elements_of_class = ElementsOfType(element_class=element_classes)
name = Element.Name(element=all_elements_of_class)
string = StringInput("IMPORT")  # graph input
contains = String.Contains(string=name, searchFor=string)
filterByBoolMask = List.FilterByBoolMask(list=all_elements_of_class, mask=contains)
# note: Custom Node: archilab
delete = archilab.Revit.Elements.Elements.Delete(element=filterByBoolMask.in)  # graph output
