# Dynamo graph Inspect_Coordinates.dyn (Dynamo 2.10.1.3976)
# packages: Rhythm 2022.11.4, Data-Shapes 2022.2.106

categories = Categories("OST_ProjectBasePoint")  # graph input
all_elements_of_category = ElementsOfCategory(Category=categories)
code_block = CodeBlock { ["N/S","E/W","Elev"]; }
ʳʰʸᵗʰᵐ_elements = Rhythm.Revit.Elements.Elements.GetParameterValueByNameTypeOrInstance(element=all_elements_of_category, parameterName=code_block@L1)
watch = Watch(ʳʰʸᵗʰᵐ_elements)  # graph output
categories_2 = Categories("OST_SharedBasePoint")  # graph input
all_elements_of_category_2 = ElementsOfCategory(Category=categories_2)
code_block_2 = CodeBlock { ["N/S","E/W","Elev"]; }
ʳʰʸᵗʰᵐ_elements_2 = Rhythm.Revit.Elements.Elements.GetParameterValueByNameTypeOrInstance(element=all_elements_of_category_2, parameterName=code_block_2@L1)
watch_2 = Watch(ʳʰʸᵗʰᵐ_elements_2)  # graph output
links = Links("CPII_GAR2_S_ALL_Coreslab_Ithamar.rvt : 1 : location <Not Shared>")  # graph input
ʳʰʸᵗʰᵐ_revitlink_getdocument = Rhythm.Revit.Elements.RevitLink.GetDocument(linkInstance=links)
element_types = ElementTypes("BasePoint")
getAllElementsFromLinks = Custom[GetAllElementsFromLinks++](Documents=ʳʰʸᵗʰᵐ_revitlink_getdocument, CategoryOrType=element_types)  # package Data-Shapes; Get all elements of category or type from given documents
select_model_element = DSModelElementSelection()  # 1 picked in the model
code_block_3 = CodeBlock { ["N/S","E/W","Elev"]; }
ʳʰʸᵗʰᵐ_elements_3 = Rhythm.Revit.Elements.Elements.GetParameterValueByNameTypeOrInstance(element=select_model_element, parameterName=code_block_3@L1)
watch_3 = Watch(ʳʰʸᵗʰᵐ_elements_3)  # graph output
categories_3 = Categories("OST_SharedBasePoint")  # graph input
getAllElementsFromLinks_2 = Custom[GetAllElementsFromLinks++](Documents=ʳʰʸᵗʰᵐ_revitlink_getdocument, CategoryOrType=categories_3)
ʳʰʸᵗʰᵐ_elements_4 = Rhythm.Revit.Elements.Elements.GetParameterValueByNameTypeOrInstance(element=getAllElementsFromLinks_2, parameterName=code_block_3@L1)
watch_4 = Watch(ʳʰʸᵗʰᵐ_elements_4)  # graph output
