# Dynamo graph Inspect_ModelComparison.dyn (Dynamo 2.10.1.3976)
# packages: Data-Shapes 2022.2.106, archi-lab.net 2022.212.3222

getDocuments = archilab.Revit.Selection.Select.GetDocuments()
code_block = CodeBlock(x=getDocuments.Link_Doc) { x[0]; }
categories = Categories("OST_SharedBasePoint")
categories_2 = Categories("OST_ProjectBasePoint")
list_create = List.Create(item0=categories, item1=categories_2)
data_shapes_modificationtracker = Custom[Data-Shapes_ModificationTracker.ModelComparison](PreviousVersionDocument=code_block, Categories=list_create)  # package Data-Shapes; Compares elements from documents A and B (A is the current document by default) and returns existing elements data, new elements, deleted elements and a report. Check out www.Data-Shapes.net for more infos.
data_shapes_modificationtracker_2 = Custom[Data-Shapes_ModificationTracker.AllChanges](ExistingElementsData=data_shapes_modificationtracker.ExistingElements_Data)  # package Data-Shapes; Takes ExistingElements Data as input and outputs lists with all geometry/parameter values change combinations . Check out www.Data-Shapes.net for more informations .
watch = Watch(data_shapes_modificationtracker_2.Report)  # graph output
watch_2 = Watch(data_shapes_modificationtracker_2.Same_geometry_different_parameter_values)  # graph output
