# Dynamo graph Tute_DoorMirroredComments.dyn (Dynamo 2.10.1.3976)

python_script = Python()  # IronPython2; unwired: IN[0]
# ---------- python_script.python (26 lines) ----------
import clr
# Import RevitAPI Dll Assembly Classes
clr.AddReference("RevitAPI")
from Autodesk.Revit.DB import FilteredElementCollector, BuiltInCategory

# Adds RevitServices Assembly and Import DocumentManager and TransactionManager
clr.AddReference("RevitServices")
from RevitServices.Transactions import TransactionManager
from RevitServices.Persistence import DocumentManager
# Create variable for Revit Document
doc = DocumentManager.Instance.CurrentDBDocument

# Start transaction
TransactionManager.Instance.EnsureInTransaction(doc)

collector = FilteredElementCollector(doc)
doors = collector.OfCategory(BuiltInCategory.OST_Doors).WhereElementIsNotElementType()

for door in doors:
	if door.Mirrored:
		comment_param = door.LookupParameter('Comments')
		# returns a parameter object
		comment_param.Set('Is Mirrored')
# End Transaction

TransactionManager.Instance.TransactionTaskDone()
# ----------------------------------------
