# Dynamo graph Tute_List Random Points.dyn (Dynamo 2.10.1.3976)

integer_slider = IntegerSlider(100, range=0..100 step 1)
randomList = Math.RandomList(amount=integer_slider)
randomList_2 = Math.RandomList(amount=integer_slider)
byCoordinates = Point.ByCoordinates(x=randomList, y=randomList_2)
integer_slider_2 = IntegerSlider(20, range=0..100 step 1)
getItemAtIndex = List.GetItemAtIndex(list=byCoordinates, index=integer_slider_2)
byCoordinates_2 = Point.ByCoordinates()
python_script = Python(IN[0]=byCoordinates, IN[1]=byCoordinates_2)  # IronPython2
# ---------- python_script.python (16 lines) ----------
import clr # Imports Ironpython's common language runtime module
clr.AddReference('ProtoGeometry') # Imports DesignScript Dll Assembly
from Autodesk.DesignScript.Geometry import Vector # Import all vector class

random_points = IN[0] # Assigns random point to a variable
origin = IN[1] # Assigns origin to a variable

distance_and_points = [] # Create an empty list to hold our new list
for point in random_points: # Iterate through each point
	vector = Vector.ByTwoPoints(origin, point) # Create vector from PT to origin
	distance = vector.Length # store vector length in a variable
	group = [distance, point] # Create a new sublist with distance and the point
	distance_and_points.append(group) # append the sublist to our main list

sorted_points = sorted(distance_and_points) # Sort the nested list
OUT = sorted_points # Output sorted list
# ----------------------------------------
